# Grasshopper definition rigid-origami-degree-4.ghx (Grasshopper 1.0.7)
# Copyright: Creative Commons Non-Commercial
# plug-ins: Human

pt = Point(Point(0, 0, 0))

# ---- group: RIGID VERTEX CONFIGURATION
fold_angle_degrees = Slider(68.979, range=-180..180)
number_slider = Slider(1, range=1..4)
alpha2 = Slider(90, range=0..180)
radius = Slider(50, range=0..100)
alpha1 = Slider(120, range=0..360)
alpha3 = Slider(110, range=0..180)
expression = Expression(x=alpha1, y=alpha2, z=alpha3, Expression="360-x-y-z")
alpha4 = Panel(expression)
rad = Radians(Degrees=alpha1)
rad_2 = Radians(Degrees=alpha2)
rad_3 = Radians(Degrees=expression)
rad_4 = Radians(Degrees=alpha3)

# ----
Y = UnitY(Factor=radius)
move = Move(Geometry=pt, Motion=Y)  # -> Geometry, Transform

# ---- group: RIGID VERTEX CONFIGURATION / re-order sector angles
python = GhPythonScript(drivingAngle=number_slider, a1=rad, a2=rad_2, a3=rad_4, a4=rad_3)  # -> out, sectorAngles, n1, n2, n3, n4; inputs drivingAngle: Int32
# ---------- python: Python ----------
__author__ = "mrg"

 


if drivingAngle == 1:
    sa = [a1,a2,a3,a4]

if drivingAngle == 2:
    sa = [a2,a3,a4,a1]

if drivingAngle == 3:
    sa = [a3,a4,a1,a2]

if drivingAngle == 4:
    sa = [a4,a1,a2,a3,]

n1 = sa[0]
n2 = sa[1]
n3 = sa[2]
n4 = sa[3]

print drivingAngle, sa

sectorAngles = sa
# ---------- end python ----------

# ---- group: FLAT VISUALISATION
rotate = Rotate(Geometry=move.Geometry, Angle=python.n1, Plane=PlaneXY(0, 0, 0))  # -> Geometry, Transform
rotate_2 = Rotate(Geometry=rotate.Geometry, Angle=python.n2, Plane=PlaneXY(0, 0, 0))  # -> Geometry, Transform
rotate_3 = Rotate(Geometry=rotate_2.Geometry, Angle=python.n3, Plane=PlaneXY(0, 0, 0))  # -> Geometry, Transform
rotate_4 = Rotate(Geometry=rotate_3.Geometry, Angle=python.n4, Plane=PlaneXY(0, 0, 0))  # -> Geometry, Transform
python_2 = GhPythonScript(center=pt, start=move.Geometry, end=rotate.Geometry)  # -> out, Arc, lines, middle; inputs center: Point3d, start: Point3d, end: Point3d, flip: Boolean
# ---------- python_2: Python ----------
import rhinoscriptsyntax as rs
import Rhino.Geometry as rg
import math


def methodA(c,s,e,f):
    angle  = rs.Angle2((c,s),(c,e))[1]
    v1 = s-c
    plane = rg.Plane(c,s,e)
    if f == True:
        angle  = -rs.Angle2((c,s),(c,e))[1]
    else:
        angle  = rs.Angle2((c,s),(c,e))[0]
    radius = v1.Length
    Arc = rg.Arc(plane,radius,math.radians(angle))
    lines = [rg.Line(c,s),
            rg.Line(c,e)]
    return Arc, lines

def methodB(c,s,e,f):
    v1 = s-c
    v2 = e-c
    plane = rg.Plane(c,s,e)
    if f == True:
        angle = rg.Vector3d.VectorAngle(v1,v2)-math.pi*2
    else:
        angle = rg.Vector3d.VectorAngle(v1,v2)
    radius = v1.Length
    Arc = rg.Arc(plane,radius,angle)
    lines = [rg.Line(c,s),
            rg.Line(c,e)]
    #lines = [rs.AddLine(c,s, rs.AddLine(c,e)]
    radius = rs.Distance(c,s)
    midpoint = rs.CreatePoint((s.X+e.X)/2, (s.Y+e.Y)/2, (s.Z+e.Z)/2)
    midVector = rs.VectorUnitize(rs.CreateVector((s.X+e.X)/2, (s.Y+e.Y)/2, (s.Z+e.Z)/2))*radius
    midpoint = c + midVector
    middle = rg.Line(midpoint, c)
    return Arc, lines, middle
    
Arc, lines, middle = methodB(center,start,end,flip)
# ---------- end python_2 ----------
python_3 = GhPythonScript(center=pt, start=rotate.Geometry, end=rotate_2.Geometry)  # -> out, Arc, lines, middle; inputs center: Point3d, start: Point3d, end: Point3d, flip: Boolean; same code as python_2
python_4 = GhPythonScript(center=pt, start=rotate_2.Geometry, end=rotate_3.Geometry)  # -> out, Arc, lines, middle; inputs center: Point3d, start: Point3d, end: Point3d, flip: Boolean; same code as python_2
python_5 = GhPythonScript(center=pt, start=rotate_3.Geometry, end=rotate_4.Geometry)  # -> out, Arc, lines, middle; inputs center: Point3d, start: Point3d, end: Point3d, flip: Boolean; same code as python_2
crv = Curve([python_3.lines, python_3.Arc])
crv_2 = Curve([python_2.Arc, python_2.lines])
crv_3 = Curve([python_4.Arc, python_4.lines])
crv_4 = Curve([python_5.Arc, python_5.lines])
number_slider_2 = Slider(5, range=0..10)
number_slider_3 = Slider(1, range=0..10)
join = JoinCurves(Curves=flatten(crv_2), Preserve=False)
join_2 = JoinCurves(Curves=flatten(crv), Preserve=False)
join_3 = JoinCurves(Curves=flatten(crv_3), Preserve=False)
join_4 = JoinCurves(Curves=flatten(crv_4), Preserve=False)
boundary = BoundarySurfaces(Edges=join)
boundary_2 = BoundarySurfaces(Edges=join_2)
boundary_3 = BoundarySurfaces(Edges=join_3)
boundary_4 = BoundarySurfaces(Edges=join_4)
deg = Degrees(Radians=python.n1)
deg_2 = Degrees(Radians=python.n2)
deg_3 = Degrees(Radians=python.n3)
deg_4 = Degrees(Radians=python.n4)
expression_2 = Expression(x=deg, Expression="Format(\"α1 {0:00}\", x)")
expression_3 = Expression(x=deg_2, Expression="Format(\"α2 {0:00}\", x)")
expression_4 = Expression(x=deg_3, Expression="Format(\"α3 {0:00}\", x)")
expression_5 = Expression(x=deg_4, Expression="Format(\"α4 {0:00}\", x)")
textsrf = TextOnSurface(
    Text=expression_2,
    Font="Sans Bold:no Italic:no",
    Height=number_slider_2,
    Depth=number_slider_3,
    BaseLine=python_2.middle,
    BaseSurface=boundary)
textsrf_2 = TextOnSurface(
    Text=expression_4,
    Font="Sans Bold:no Italic:no",
    Height=number_slider_2,
    Depth=number_slider_3,
    BaseLine=python_4.middle,
    BaseSurface=boundary_3)
textsrf_3 = TextOnSurface(
    Text=expression_3,
    Font="Sans Bold:no Italic:no",
    Height=number_slider_2,
    Depth=number_slider_3,
    BaseLine=python_3.middle,
    BaseSurface=boundary_2)
textsrf_4 = TextOnSurface(
    Text=expression_5,
    Font="Sans Bold:no Italic:no",
    Height=number_slider_2,
    Depth=number_slider_3,
    BaseLine=python_5.middle,
    BaseSurface=boundary_4)
panel = Panel("200,200,200")
panel_2 = Panel("125,125,125")
previewmat = CustomPreviewMaterials(Geometry=boundary, DiffuseColor=panel)
previewmat_2 = CustomPreviewMaterials(Geometry=boundary_3, DiffuseColor=panel_2)
previewmat_3 = CustomPreviewMaterials(Geometry=boundary_4, DiffuseColor=panel_2)
previewmat_4 = CustomPreviewMaterials(Geometry=boundary_2, DiffuseColor=panel_2)
previewmat_5 = CustomPreviewMaterials(Geometry=[textsrf, textsrf_3, textsrf_2, textsrf_4], DiffuseColor="0,0,0")

# ---- group: to bake
geo = Geometry([join, join_4, join_3, join_2])

# ---- group: 3D KINETIC
rigid_origami_calculate = GhPythonScript(mode=Toggle(True), a1=python.n1, a2=python.n2, a3=python.n3, a4=python.n4, angleDegrees=fold_angle_degrees)  # -> out, rho_1, rho_2, rho_3, rho_4, rho_1max, ERROR
# ---------- rigid_origami_calculate: Python ----------
__author__ = "mrg"

import rhinoscriptsyntax as rs
import math

def sin2(a):
    return math.sin(a)*math.sin(a)

def tan2(a):
    return math.tan(a)*math.tan(a)
    
def rigidMinMax (sectorAngles):
    # sector angles are shifted, due to different notation in each paper
    a1 = sectorAngles[1]
    a2 = sectorAngles[2]
    a3 = sectorAngles[3]
    a4 = sectorAngles[0]
    rho_1 = math.acos(((math.cos(a1)*math.cos(a4))-math.cos(a2-a3))/math.sin(a1)*math.sin(a4))
    # @TODO the following don't work due to math domain errors 
    #p2 = math.acos((math.cos(a2)*math.cos(a1)-math.cos(a3-a4))/math.sin(a2)*math.sin(a1))
    #p3 = math.acos((math.cos(a3)*math.cos(a2)-math.cos(a4-a1))/math.sin(a3)*math.sin(a2))
    #rho_4 = math.acos((math.cos(a4)*math.cos(a3)-math.cos(a1-a2))/math.sin(a4)*math.sin(a3))
    return -rho_1, rho_1 #, -p2, p2, -p3, p3 #, -rho_4, rho_4
    
def rigidKinematics (sectorAngles, pDegrees):
    # p = angle in degrees
    rho_4 = math.radians(pDegrees)
    a1 = sectorAngles[0]
    a2 = sectorAngles[1]
    a3 = sectorAngles[2]
    a4 = sectorAngles[3]

    print ("a1", math.degrees(a1), "a2", math.degrees(a2), "a3", math.degrees(a3), "a4", math.degrees(a4))
    cosa2 = math.cos(a2)
    l1 = 2*math.sin(a1)*math.sin(a2)*math.tan(rho_4/2)
    l2 = 4*sin2(a1)*sin2(a3)*tan2(rho_4/2) - (cosa2 - math.cos(a1 - a3 - a4) + (cosa2 - math.cos(a1 + a3 - a4))* tan2(rho_4/2)) * (cosa2 - math.cos(a1 + a3 + a4) + (cosa2 - math.cos(a1 - a3 + a4))* tan2(rho_4/2))  
    l3_1 = cosa2
    if cosa2 - math.cos(a1 - a3 - a4) == 0:
        ERROR = "mountain valley assignment is impossible"
        return "error", "error"
    else: 
        l3 = cosa2 - math.cos(a1 - a3 - a4) + (cosa2 - math.cos(a1 + a3 - a4))* tan2(rho_4/2)     
        halftanP1 = abs(l1 * math.sqrt(l2)/l3)
        P1  = 2*math.atan(halftanP1)
        P1_ = -P1
        print (P1, P1_)
        return P1, P1_


#sectorAngleRadians = [a1,a2,a3,a4]
sectorAngleRadians = [a4,a1,a2,a3]
rho_1, rho_1_ = rigidKinematics (sectorAngleRadians, angleDegrees)
if rho_1 != "error":
    ERROR = "NO ERROR: this configuration is valid" 
    rho_1min, rho_1max = rigidMinMax (sectorAngleRadians)
    rho_4 = math.radians(angleDegrees)
#    print p1min, p1max, p2min, p2max, p3min, p3max

    if mode == 0:
        rho_1 = rho_1
    
    if mode == 1:
        rho_1 = rho_1_
    print ("angle", angleDegrees, "rho_1", rho_1, rho_1_)
else: 
   ERROR = "ERROR: this configuration is invalid, use a different driving angle"
# ---------- end rigid_origami_calculate ----------
pt_2 = Point(rotate.Geometry)
pt_3 = Point(rotate_2.Geometry)
pt_4 = Point(rotate_3.Geometry)
pt_5 = Point(rotate_4.Geometry)
ln = Line(StartPoint=pt, EndPoint=pt_5)
ln_2 = Line(StartPoint=pt, EndPoint=pt_2)
rotax = RotateAxis(Geometry=pt_4, Angle=rigid_origami_calculate.rho_4, Axis=ln)  # -> Geometry, Transform
rotax_2 = RotateAxis(Geometry=pt_3, Angle=rigid_origami_calculate.rho_1, Axis=ln_2)  # -> Geometry, Transform
python_6 = GhPythonScript(center=pt, start=pt_5, end=rotax.Geometry)  # -> out, Arc, lines, middle; inputs center: Point3d, start: Point3d, end: Point3d, flip: Boolean; same code as python_2
python_7 = GhPythonScript(center=pt, start=rotax.Geometry, end=rotax_2.Geometry)  # -> out, Arc, lines, middle; inputs center: Point3d, start: Point3d, end: Point3d, flip: Boolean; same code as python_2
python_8 = GhPythonScript(center=pt, start=rotax_2.Geometry, end=pt_2)  # -> out, Arc, lines, middle; inputs center: Point3d, start: Point3d, end: Point3d, flip: Boolean; same code as python_2
crv_5 = Curve([python_7.Arc, python_7.lines])
crv_6 = Curve([python_8.Arc, python_8.lines])
crv_7 = Curve([python_6.Arc, python_6.lines])
join_5 = JoinCurves(Curves=flatten(crv_5), Preserve=False)
join_6 = JoinCurves(Curves=flatten(crv_6), Preserve=False)
join_7 = JoinCurves(Curves=flatten(crv_7), Preserve=False)
multiplication = Multiplication(A=radius, B=2.5)
boundary_5 = BoundarySurfaces(Edges=join_5)
boundary_6 = BoundarySurfaces(Edges=join_6)
boundary_7 = BoundarySurfaces(Edges=join_7)
X = UnitX(Factor=multiplication)
rgb = ColourRGB(Alpha=255, Red=0, Green=0, Blue=0)
move_2 = Move(Geometry=[join_7, join_5, join_6, join], Motion=X)  # -> Geometry, Transform
move_3 = Move(Geometry=boundary, Motion=X)  # -> Geometry, Transform
move_4 = Move(Geometry=[boundary_7, boundary_5, boundary_6, boundary], Motion=X)  # -> Geometry, Transform
move_5 = Move(Geometry=[boundary_7, boundary_5, boundary_6, boundary], Motion=X)  # -> Geometry, Transform
move_6 = Move(Geometry=[boundary_7, boundary_5, boundary_6, boundary], Motion=X)  # -> Geometry, Transform
previewmat_6 = CustomPreviewMaterials(Geometry=[move_4.Geometry, move_5.Geometry, move_6.Geometry], DiffuseColor=panel_2)
previewmat_7 = CustomPreviewMaterials(Geometry=move_3.Geometry, DiffuseColor=panel)
previewlw = CustomPreviewLineweights(Geometry=move_2.Geometry, Shader=rgb, Thickness=Slider(2, range=0..10), Absolute=False)

# ----
panel_3 = Panel(rigid_origami_calculate.ERROR)

# ---- group: RIGID VERTEX CONFIGURATION / a1-a4
subtraction = Subtraction(A=python.n1, B=python.n4)
abs = Absolute(Value=subtraction)
panel_4 = Panel(abs)

# ---- group: RIGID VERTEX CONFIGURATION / a2-A3
subtraction_2 = Subtraction(A=python.n2, B=python.n3)
abs_2 = Absolute(Value=subtraction_2)
panel_5 = Panel(abs_2)

# ---- group: RIGID VERTEX CONFIGURATION (continued)
panel_6 = Panel(python.sectorAngles)
max_angle = Panel(rigid_origami_calculate.rho_1max)
larger = LargerThan(FirstNumber=panel_4, SecondNumber=panel_5)  # -> LargerThan, OrEqualTo
rigid_vertex = Panel(larger.OrEqualTo)

# ----
expression_6 = Expression(a1=python.n1, a2=python.n2, a3=python.n3, a4=python.n4, Expression="If(a1-a2+a3-a4=0, true, false)")
is_flat_foldable = Panel(expression_6)
