# Grasshopper definition thysan-fabricator.ghx (Grasshopper 1.0.8)
# Copyright: Creative Commons Non-Commercial
# plug-ins: RhinoCodePluginGH, Human

# ---- group: h height
number_slider = Slider(43.9, range=0..100)

# ---- group: FABRICATION PARAMETERS
slot_breaks = Slider(2, range=0..10)
number_slider_2 = Slider(5, range=0..50)
scale_factor = Slider(0.3, range=0..1)
slot_width = Slider(0, range=0..10)
corner_radius = Slider(3.384, range=0..50)

# ---- group: ORIGIN
pt = Point(Point(0, 0, 0))

# ---- group: THYSAN GEOMETRY
flat_width = Slider(21.12759, range=1..100)
outer_circle = Slider(684, range=0..1000)
bottom_radius = Slider(74, range=0..100)
hole_diameter = Slider(17, range=0..40)

# ---- group: GRAPH
pt_2 = Point(Point(-92, -627, 0))

# ---- group: THYSAN PARAMETERS
alpha3 = Slider(117.936, range=100..130)
linkage_a = Slider(60, range=0..100)
linkage_c = Slider(0, range=-50..50)

# ----
subtraction = Subtraction(A="100", B=linkage_a)

# ---- group: THYSAN PARAMETERS (continued)
linkage_b = Panel(subtraction)

# ---- group: GRAPH (continued)
cluster = Cluster_2(
    graph_origin=pt_2,
    origin_point=pt,
    height=number_slider,
    linkagea=linkage_a,
    linkageb=subtraction,
    linkagec=linkage_c,
    rigid=alpha3,
    iterations=Slider(50, range=0..1000),
    translation=number_slider)  # -> graph_frame, graph_outline, rigid_curve, theta_graph_line, zeroh, h_line

# ---- group: h value limits
S = Script(height=number_slider, a=linkage_a, b=subtraction, c=linkage_c)  # -> out, hzero, hmin, hmax, hconstrained, hrange
# ---------- S: Python ----------
"""Grasshopper Script"""

print(a, b, c)

import math

def minH(a,b,c):
    return math.sqrt(abs(math.pow(a-b, 2) - math.pow(c,2)))

def maxH(a,b,c):
    return math.sqrt(abs(math.pow(a+b, 2) - math.pow(c,2)))
    
hmin = minH(a,b,c)
hmax = maxH(a,b,c)
hzero = math.sqrt(abs(a**2 - (b+c)**2))

hrange = hmax - hmin

hconstrained = height

if height < hmin:
    hconstrained = hmin

if height > hmax:
    hconstrained = hmax
# ---------- end S ----------
h_zero = Panel(S.hzero)
h_max = Panel(S.hmax)
h_min = Panel(S.hmin)
# 100
# flat width 51.4
# outer circle 530
# 
# 110
# flat width 37.3
# outer circle 725
# 
# 
# 115
# flat witdth 27.8
# outer circle 970
# 
# bottom radius
# 74
h_range = Panel(S.hrange)

# ----
subtraction_2 = Subtraction(A=150, B=alpha3)

# ---- group: SCALED VALUES
python = GhPythonScript(
    scaleFactor=scale_factor,
    linkageA=linkage_a,
    linkageB=subtraction,
    linkageC=linkage_c,
    bottomRadius=bottom_radius,
    outerCircle=outer_circle,
    heightRange=S.hrange,
    holeDiameter=hole_diameter,
    slotWidth=slot_width,
    connectorLink=number_slider_2)  # -> out, sLinkageA, sLinkageB, sLinkageC, sBottomRadius, sOuterCircle, sHeightRange, sHoleDiameter, sSlotWidth, sConnectorLink
# ---------- python: Python ----------
__author__ = "mrg"

import rhinoscriptsyntax as rs

sLinkageA     = linkageA*scaleFactor
sLinkageB     = linkageB*scaleFactor
sLinkageC     = linkageC*scaleFactor
sBottomRadius = bottomRadius*scaleFactor
sOuterCircle  = outerCircle*scaleFactor
sHeightRange  = (100-heightRange)*scaleFactor
sHoleDiameter = holeDiameter*scaleFactor
sSlotWidth   = slotWidth/2*scaleFactor
sConnectorLink   = connectorLink*scaleFactor
# ---------- end python ----------
panel = Panel(python.sSlotWidth)
panel_2 = Panel(python.sConnectorLink)
panel_3 = Panel(python.sLinkageA)
panel_4 = Panel(python.sLinkageB)
panel_5 = Panel(python.sLinkageC)
panel_6 = Panel(python.sBottomRadius)
panel_7 = Panel(python.sOuterCircle)
panel_8 = Panel(python.sHeightRange)
panel_9 = Panel(python.sHoleDiameter)

# ----
cluster_2 = Cluster_3(alpha_3=alpha3)
panel_10 = Panel(subtraction_2)
h_constrained = Panel(S.hconstrained)

# ---- group: GRAPH
rgb = ColourRGB(Alpha=255, Red=Slider(0, range=0..255), Green=Slider(0, range=0..255), Blue=Slider(0, range=0..255))
previewlw = CustomPreviewLineweights(Geometry=cluster.h_line, Shader=rgb, Thickness=Slider(2, range=0..5), Absolute=False)

rgb_2 = ColourRGB(Alpha=255, Red=Slider(50, range=0..255), Green=Slider(50, range=0..255), Blue=Slider(50, range=0..255))
previewlw_2 = CustomPreviewLineweights(Geometry=cluster.graph_frame, Shader=rgb_2, Thickness=Slider(1, range=0..5), Absolute=False)

rgb_3 = ColourRGB(Alpha=255, Red=Slider(0, range=0..255), Green=Slider(0, range=0..255), Blue=Slider(0, range=0..255))
previewlw_3 = CustomPreviewLineweights(Geometry=cluster.graph_outline, Shader=rgb_3, Thickness=Slider(4, range=0..5), Absolute=False)

rgb_4 = ColourRGB(Alpha=255, Red=Slider(255, range=0..255), Green=Slider(0, range=0..255), Blue=Slider(0, range=0..255))
previewlw_4 = CustomPreviewLineweights(Geometry=cluster.rigid_curve, Shader=rgb_4, Thickness=Slider(3, range=0..5), Absolute=False)

rgb_5 = ColourRGB(Alpha=255, Red=Slider(0, range=0..255), Green=Slider(0, range=0..255), Blue=Slider(255, range=0..255))
previewlw_5 = CustomPreviewLineweights(Geometry=cluster.theta_graph_line, Shader=rgb_5, Thickness=Slider(4, range=0..5), Absolute=False)

# ----
rigid_vertex = Panel(cluster_2)

# ---- group: 3D
cluster_3 = Cluster(
    height=S.hconstrained,
    linkagea=linkage_a,
    linkageb=subtraction,
    linkagec=linkage_c,
    bottomradius=bottom_radius,
    rigid=alpha3,
    outercircle=outer_circle,
    holediameter=hole_diameter,
    origin=pt,
    flatwidth=flat_width)  # -> _3d_curves, innerfoldlength, washi_folds, washi_cuts, washi_folds_2, washi_cuts_2, kraft_cuts, kraft_slots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

# ----
perfect_flat_width = Panel(cluster_3.flatwidth_2)

# ---- group: MOVE THE 3D MODEL TO THE SIDE
X = UnitX(Factor=Slider(1000, range=0..1000))
crv = Curve(cluster_3._3d_curves)
move = Move(Geometry=crv, Motion=X)  # -> Geometry, Transform

# ---- group: PLATES
crv_2 = Curve(cluster_3.top_plate)
crv_3 = Curve(cluster_3.bottom_plate)

# ---- group: WASHI FOLDS
crv_4 = Curve(cluster_3.washi_folds)

# ---- group: WASHI CUTS
crv_5 = Curve(cluster_3.washi_cuts)

# ---- group: WASHI FOLDS 2
crv_6 = Curve(cluster_3.washi_folds_2)

# ---- group: WASHI CUTS 2
crv_7 = Curve(cluster_3.washi_cuts_2)

# ---- group: KRAFT CUTS
crv_8 = Curve(cluster_3.kraft_cuts)

# ---- group: KRAFT SLOTS
crv_9 = Curve(cluster_3.kraft_slots)

# ---- group: KRAFT DASHES
crv_10 = Curve(cluster_3.kraft_folds)

# ----
slot_maker = SLOTMAKER(curves_to_slot=crv_9, breaks=slot_breaks, slot_width=slot_width, radius=number_slider_2)

# ---- group: SCALED KRAFT CUTS
pt_3 = Point(Point(660, -386, 0))
scale = Scale(Geometry=[crv_8, slot_maker], Center=Point(0, 0, 0), Factor=scale_factor)  # -> Geometry, Transform
subtraction_3 = Subtraction(A=pt_3, B=pt)
scale_2 = Scale(Geometry=crv_10, Center=Point(0, 0, 0), Factor=scale_factor)  # -> Geometry, Transform
subtraction_4 = Subtraction(A=pt_3, B=pt)
move_2 = Move(Geometry=scale.Geometry, Motion=subtraction_3)  # -> Geometry, Transform
move_3 = Move(Geometry=scale_2.Geometry, Motion=subtraction_4)  # -> Geometry, Transform

# ---- group: SCALED PLATES
pt_4 = Point(Point(898, -390, 0))
scale_3 = Scale(Geometry=crv_2, Center=Point(0, 0, 0), Factor=scale_factor)  # -> Geometry, Transform
subtraction_5 = Subtraction(A=pt_4, B=pt)
scale_4 = Scale(Geometry=crv_3, Center=Point(0, 0, 0), Factor=scale_factor)  # -> Geometry, Transform
subtraction_6 = Subtraction(A=pt_4, B=pt)
move_4 = Move(Geometry=scale_3.Geometry, Motion=subtraction_5)  # -> Geometry, Transform
move_5 = Move(Geometry=scale_4.Geometry, Motion=subtraction_6)  # -> Geometry, Transform

# ---- group: SCALED WASHI CUTS
pt_5 = Point(Point(151, -383, 0))
scale_5 = Scale(Geometry=crv_4, Center=Point(0, 0, 0), Factor=scale_factor)  # -> Geometry, Transform
subtraction_7 = Subtraction(A=pt_5, B=pt)
scale_6 = Scale(Geometry=crv_5, Center=Point(0, 0, 0), Factor=scale_factor)  # -> Geometry, Transform
subtraction_8 = Subtraction(A=pt_5, B=pt)
move_6 = Move(Geometry=scale_5.Geometry, Motion=subtraction_7)  # -> Geometry, Transform
move_7 = Move(Geometry=scale_6.Geometry, Motion=subtraction_8)  # -> Geometry, Transform

pt_6 = Point(Point(389, -384, 0))
scale_7 = Scale(Geometry=crv_6, Center=Point(0, 0, 0), Factor=scale_factor)  # -> Geometry, Transform
subtraction_9 = Subtraction(A=pt_6, B=pt)
scale_8 = Scale(Geometry=crv_7, Center=Point(0, 0, 0), Factor=scale_factor)  # -> Geometry, Transform
subtraction_10 = Subtraction(A=pt_6, B=pt)
move_8 = Move(Geometry=scale_7.Geometry, Motion=subtraction_9)  # -> Geometry, Transform
move_9 = Move(Geometry=scale_8.Geometry, Motion=subtraction_10)  # -> Geometry, Transform

# ----
crv_11 = Curve([move.Geometry, crv_8])
crv_12 = Curve([crv_6, crv_10])
crv_13 = Curve([move_4.Geometry, move_5.Geometry])
crv_14 = Curve([move_2.Geometry, move_9.Geometry, move_7.Geometry])
crv_15 = Curve([move_8.Geometry, move_3.Geometry, move_6.Geometry])

# ---- group: CUTS
rgb_6 = ColourRGB(Alpha=255, Red=Slider(0, range=0..255), Green=Slider(0, range=0..255), Blue=Slider(0, range=0..255))
previewlw_6 = CustomPreviewLineweights(Geometry=crv_13, Shader=rgb_6, Thickness=Slider(1, range=0..5), Absolute=False)

rgb_7 = ColourRGB(Alpha=255, Red=Slider(0, range=0..255), Green=Slider(0, range=0..255), Blue=Slider(0, range=0..255))
previewlw_7 = CustomPreviewLineweights(Geometry=crv_11, Shader=rgb_7, Thickness=Slider(3, range=0..5), Absolute=False)

rgb_8 = ColourRGB(Alpha=255, Red=Slider(255, range=0..255), Green=Slider(0, range=0..255), Blue=Slider(0, range=0..255))
previewlw_8 = CustomPreviewLineweights(Geometry=crv_12, Shader=rgb_8, Thickness=Slider(2, range=0..5), Absolute=False)

# ---- group: FOLDS
rgb_9 = ColourRGB(Alpha=255, Red=Slider(255, range=0..255), Green=Slider(0, range=0..255), Blue=Slider(0, range=0..255))
previewlw_9 = CustomPreviewLineweights(Geometry=crv_15, Shader=rgb_9, Thickness=Slider(1, range=0..5), Absolute=False)

# ---- group: CUTS
rgb_10 = ColourRGB(Alpha=255, Red=Slider(0, range=0..255), Green=Slider(0, range=0..255), Blue=Slider(0, range=0..255))
previewlw_10 = CustomPreviewLineweights(Geometry=crv_14, Shader=rgb_10, Thickness=Slider(0, range=0..5), Absolute=False)

# ==== cluster Cluster
bottomradius = ClusterInput()
number_slider = Slider(26.19, range=0..100)
linkagea = ClusterInput()
linkageb = ClusterInput()
linkagec = ClusterInput()
rigid = ClusterInput()
outercircle = ClusterInput()
holediameter = ClusterInput()
origin = ClusterInput()
flatwidth = ClusterInput()
height = ClusterInput()
number_slider_2 = Slider(3, range=0..10)
division = Division(A=linkagec, B=2)
division_2 = Division(A=outercircle, B=2)
addition = Addition(A=bottomradius, B=division)

addition_2 = Addition(A=addition, B=linkagea)
addition_3 = Addition(A=addition_2, B=linkageb)
addition_4 = Addition(A=addition_3, B=bottomradius)
multiplication = Multiplication(A=addition_4, B=-1)
X = UnitX(Factor=multiplication)
move = Move(Geometry=origin, Motion=X)  # -> Geometry, Transform

# ---- group: 3 way rotation
rad = Radians(Degrees="120")
series = Series(Start=0, Step=rad, Count="3")

# ----
X_2 = UnitX(Factor=division_2)
addition_5 = Addition(A=addition, B=linkageb)

division_3 = Division(A=holediameter, B=2)
cir = Circle(Plane=PlaneXY(0, 0, 0), Radius=division_3)
move_2 = Move(Geometry=cir, Motion=X)  # -> Geometry, Transform

expression = Expression(r=addition, n=number_slider_2, Expression="r/Cos((2*π/n)/2)")
expression_2 = Expression(r=addition_5, n=number_slider_2, Expression="r/Cos((2*π/n)/2)")
move_3 = Move(Geometry=origin, Motion=X_2)  # -> Geometry, Transform
division_4 = Division(A=flatwidth, B=2)
multiplication_2 = Multiplication(A=division_4, B=-1)
ln = Line(StartPoint=origin, EndPoint=move_3.Geometry)
polygon = Polygon(Plane=PlaneXY(0, 0, 0), Radius=expression, Segments=number_slider_2, FilletRadius=0)  # -> Polygon, Length
polygon_2 = Polygon(Plane=PlaneXY(0, 0, 0), Radius=expression_2, Segments=number_slider_2, FilletRadius=0)  # -> Polygon, Length

Y = UnitY(Factor=Slider(100, range=0..100))
move_4 = Move(Geometry=origin, Motion=Y)  # -> Geometry, Transform
xz = XZPlane(Origin=Point(0, 0, 0))
mirror = Mirror(Geometry=move_4.Geometry, Plane=xz)  # -> Geometry, Transform
multiplication_3 = Multiplication(A=addition_3, B=-1)
ln_2 = Line(StartPoint=move_4.Geometry, EndPoint=mirror.Geometry)
X_3 = UnitX(Factor=multiplication_3)
move_5 = Move(Geometry=ln_2, Motion=X_3)  # -> Geometry, Transform

cir_2 = Circle(Plane=move_3.Geometry, Radius=flatwidth)
offcrv = OffsetCurve(Curve=ln, Plane=PlaneXY(0, 0, 0), Distance=division_4, BothSides=multiplication_2, Kinks=0, CapType=1)
crv = Curve(polygon.Polygon)
crv_2 = Curve(polygon_2.Polygon)
ccx = CurveCurve(CurveA=cir_2, CurveB=offcrv)  # -> Points, ParamsA, ParamsB
ccx_2 = CurveCurve(CurveA=crv, CurveB=offcrv)  # -> Points, ParamsA, ParamsB
dispatch = Dispatch(List=ccx.Points, DispatchPattern=[True, False])  # -> ListA, ListB
dispatch_2 = Dispatch(List=ccx_2.Points, DispatchPattern=[True, False])  # -> ListA, ListB
dispatch_3 = Dispatch(List=ccx_2.Points, DispatchPattern=[True, False])  # -> ListA, ListB

# ---- group: BOTTOM PLATE POLYGON
expression_3 = Expression(r=bottomradius, n=number_slider_2, Expression="r/Cos((2*π/n)/2)")
polygon_3 = Polygon(Plane=move.Geometry, Radius=expression_3, Segments=number_slider_2, FilletRadius=0)  # -> Polygon, Length
explode = Explode(Curve=polygon_3.Polygon, Recursive=True)  # -> Segments, Vertices
panel = Panel("""0
2""")
item = ListItem(List=explode.Segments, Index=panel, Wrap=True)
llx = LineLine(Line1=flatten(item), Line2=move_5.Geometry)  # -> ParamA, ParamB, PointA, PointB
dispatch_4 = Dispatch(List=llx.PointA, DispatchPattern=[True, False])  # -> ListA, ListB
ln_3 = Line(StartPoint=dispatch_4.ListA, EndPoint=dispatch_4.ListB)

# ----
rad_2 = Radians(Degrees=rigid)

# ---- group: FOLD
ln_4 = Line(StartPoint=dispatch_2.ListA, EndPoint=dispatch_2.ListB)

# ---- group: CUT
ln_5 = Line(StartPoint=dispatch.ListA, EndPoint=dispatch.ListB)

# ---- group: FOLD
ln_6 = Line(StartPoint=ccx_2.Points, EndPoint=ccx.Points)

# ----
pt = Point(dispatch.ListA)
python = GhPythonScript(height=height, linkageA=linkagea, linkageB=linkageb, linkageC=linkagec)  # -> out, theta0
# ---------- python: Python ----------
__author__ = "mrg"

import rhinoscriptsyntax as rs
import math

def getD(h,c):
    return math.sqrt(abs(math.pow(c,2) + math.pow(h,2)))


def getAngles(a,b,c,h):
	# equation 1
	d = getD(h,c)
	#print ("d", h, d)
	# equation 2
	theta2 = math.degrees(math.acos(c/d))
	#print ("theta2", h, theta2)
	if theta2 == 0:
		return -1, -1, -1
	# equation 3
	costheta1 = ( math.pow(d,2) + math.pow(b,2) - math.pow(a,2) )/(2*d*b)
	if costheta1 > 1:
		return -1, -1, -1
	if costheta1 < -1:
		return -1, -1, -1
	#print("costheta1", h, costheta1)
	theta1 = math.degrees(math.acos(costheta1))
	#print ("theta1", h, theta1)
	sinThetaD = a * math.sin(math.radians(theta1))/d 
	thetaD = math.asin(sinThetaD)
	theta0 = 180 - theta1 - theta2
	#print ("theta0", h, theta0)
	return theta0, theta1, theta2, thetaD

def getTheta0(a,b,c,h):
    # equation 1
    d = getD(h,c)
    #print("getTheta0", a, b, c, d, h)
    if d > 0:
        if (d >= a+b):
            #print "d is longer"
            costhetaA = 1
            thetaH = math.degrees(math.acos(c/(a+b)))
        else:
            # equation 2
            thetaH = math.degrees(math.acos(c/d))
            # equation 3
            costhetaA = ( math.pow(d,2) + math.pow(b,2) - math.pow(a,2) )/(2*d*b)
            #print "d", d, "a+b", a+b, "cosø", costhetaA, "øh", thetaH
        if costhetaA < -1:
            costhetaA = -1
        thetaA = math.degrees(math.acos(costhetaA))
        theta0 = 180 - thetaH - thetaA
        return theta0
    else:
         return 0   


d = getD(height,linkageC)
#theta0, theta1, theta2, thetaD = getAngles(linkageA,linkageB,linkageC,height)
theta0 = getTheta0(linkageA,linkageB,linkageC,height)

print theta0
# ---------- end python ----------
dispatch_5 = Dispatch(List=ln_6, DispatchPattern=[True, False])  # -> ListA, ListB
rotate = Rotate(Geometry=dispatch_5.ListA, Angle=rad_2, Plane=ccx_2.Points)  # -> Geometry, Transform
len = Length(Curve=ln_6)
dispatch_6 = Dispatch(List=rotate.Geometry, DispatchPattern=[True, False])  # -> ListA, ListB
python_2 = GhPythonScript(rigid=rigid, angle=python.theta0)  # -> out, a
# ---------- python_2: Python ----------
__author__ = "mrg"

import rhinoscriptsyntax as rs

import math

def sin2(a):
    return math.sin(a)*math.sin(a)

def tan2(a):
    return math.tan(a)*math.tan(a)


def rigidKinematics (sectorAngles, pDegrees):
    # p = angle in degrees
    p = math.radians(pDegrees)
    a1 = sectorAngles[0]
    a2 = sectorAngles[1]
    a3 = sectorAngles[2]
    a4 = sectorAngles[3]
    cosa2 = math.cos(a2)
    l1 = 2*math.sin(a1)*math.sin(a2)*math.tan(p/2)
    l2 = 4*sin2(a1)*sin2(a3)*tan2(p/2) - (cosa2 - math.cos(a1 - a3 - a4) + (cosa2 - math.cos(a1 + a3 - a4))* tan2(p/2)) * (cosa2 - math.cos(a1 + a3 + a4) + (cosa2 - math.cos(a1 - a3 + a4))* tan2(p/2)) 
    print ("l2", l2)
    l3 = cosa2 - math.cos(a1 - a3 - a4) + (cosa2 - math.cos(a1 + a3 - a4))* tan2(p/2)
    halftanP = l1 * math.sqrt(l2)/l3
    halftanP_ = -l1 * math.sqrt(l2)/l3
    P  = 2*math.atan(halftanP)
    P_ = 2*math.atan(halftanP_)
    #P  = math.degrees(P)
    #P_ = math.degrees(P_)
    print (P, P_)
    return P, P_

rigidB = 360 - 90 - 120 - rigid

sectorAnglesDegrees = [90, rigid, rigidB, 120]  # [135, 45, 135, 45] #  #120,90,110,40]
#sectorAnglesDegrees.reverse()
print ("sectorAnglesDegrees", sectorAnglesDegrees)
sectorAngleRadians = [0,0,0,0]
for i,sa in enumerate(sectorAnglesDegrees):
    sectorAngleRadians[i] = math.radians(sa)
print ("sectorAngleRadians", sectorAngleRadians)

p, p_ = rigidKinematics (sectorAngleRadians, angle)

#for a in range(1,90):
    #print (sectorAngleRadians)

#    
print "angle", angle, "p", p, p_

a = p_
# ---------- end python_2 ----------
explode_2 = Explode(Curve=crv_2, Recursive=True)  # -> Segments, Vertices
item_2 = ListItem(List=len, Index=0, Wrap=True)
item_3 = ListItem(List=explode_2.Segments, Index=0, Wrap=True)
line = Line(dispatch_6.ListA)
crv_3 = Curve([ln_5, ln_6])
xz_2 = XZPlane(Origin=Point(0, 0, 0))
panel_2 = Panel(python.theta0)
dispatch_7 = Dispatch(List=ccx_2.Points, DispatchPattern=[True, False])  # -> ListA, ListB
llx_2 = LineLine(Line1=item_3, Line2=line)  # -> ParamA, ParamB, PointA, PointB
innerfoldlength = ClusterOutput(item_2)

# ---- group: linkage A
mirror_2 = Mirror(Geometry=llx_2.PointA, Plane=xz_2)  # -> Geometry, Transform
pt_2 = Point([llx_2.PointA, mirror_2.Geometry])
rotate_2 = Rotate(Geometry=graft(pt_2), Angle=series, Plane=PlaneXY(0, 0, 0))  # -> Geometry, Transform
panel_3 = Panel("""1
5""")
item_4 = ListItem(List=flatten(rotate_2.Geometry), Index=panel_3, Wrap=True)
dispatch_8 = Dispatch(List=item_4, DispatchPattern=[True, False])  # -> ListA, ListB
ln_7 = Line(StartPoint=dispatch_8.ListA, EndPoint=dispatch_8.ListB)

# ----
xz_3 = XZPlane(Origin=Point(0, 0, 0))
pt_3 = Point(dispatch_7.ListA)
mirror_3 = Mirror(Geometry=pt_3, Plane=xz_3)  # -> Geometry, Transform
rotate_3 = Rotate(Geometry=graft([pt_3, mirror_3.Geometry]), Angle=series, Plane=PlaneXY(0, 0, 0))  # -> Geometry, Transform
pt_4 = Point(flatten([pt_3, rotate_3.Geometry]))
item_5 = ListItem(List=pt_4, Index="5", Wrap=False)
item_6 = ListItem(List=pt_4, Index="0", Wrap=False)
ln_8 = Line(StartPoint=item_6, EndPoint=item_5)
rotate_4 = Rotate(Geometry=graft(ln_8), Angle=series, Plane=PlaneXY(0, 0, 0))  # -> Geometry, Transform

# ---- group: 3D CURVES / 3D center strip
rotax = RotateAxis(Geometry=ccx.Points, Angle=python_2.a, Axis=ln_4)  # -> Geometry, Transform
dispatch_9 = Dispatch(List=rotax.Geometry, DispatchPattern=[True, False])  # -> ListA, ListB
ln_9 = Line(StartPoint=ccx_2.Points, EndPoint=rotax.Geometry)
ln_10 = Line(StartPoint=dispatch_9.ListA, EndPoint=dispatch_9.ListB)

# ----
len_2 = Length(Curve=ln_3)
subtraction = Subtraction(A=150, B=rigid)

# ---- group: FOLD
ln_11 = Line(StartPoint=llx_2.PointA, EndPoint=dispatch_7.ListA)

# ---- group: CUT
ln_12 = Line(StartPoint=pt, EndPoint=llx_2.PointA)

# ----
panel_4 = Panel(subtraction)
xy = XYPlane(Origin=move.Geometry)
panel_5 = Panel(linkagec)

# ---- group: PRE MIRRORED CUTS
crv_4 = Curve([ln_12, ln_5])

# ----
py3 = Python3Script(n=len_2, r=bottomradius, a=linkagea, b=linkageb, c=linkagec, rigid=panel_4)  # -> out, w; inputs n: Double, r: Double, a: Double, b: Double, c: Double, rigid: Double
# ---------- py3: Python ----------
import math

n = n / 2
print (n)
x = math.radians(rigid)
r = r + (c/2)
print ("r", r)

gamma_2 = (math.pi/2) - x

e = (a / math.sin(x)) * math.sin(gamma_2)
f = (a / math.sin(x)) * math.sin(math.pi)
m = n + e

theta_1 = math.atan(n/r)
theta_2 = math.atan(m/r)
theta_3 = math.radians(60) - theta_2
g = m / math.sin(theta_2)
w = g*math.sin(theta_3)*2

print ("e", e)
print ("f", f)
print ("g", g)
print ("n", n)
print ("m", m)
print ("m/r", m/r)
print ("w", w)
# ---------- end py3 ----------

# ---- group: PRE MIRRORED FOLDS
crv_5 = Curve([ln_11, ln_6])

# ----
rotate_5 = Rotate(Geometry=graft(ln_3), Angle=series, Plane=xy)  # -> Geometry, Transform
panel_6 = Panel(py3.w)
rotate_6 = Rotate(Geometry=graft(ln_4), Angle=series, Plane=PlaneXY(0, 0, 0))  # -> Geometry, Transform
rotate_7 = Rotate(Geometry=ln_3, Angle=series, Plane=xy)  # -> Geometry, Transform
rotate_8 = Rotate(Geometry=ln_7, Angle=series, Plane=xy)  # -> Geometry, Transform
panel_7 = Panel("""1
2""")
end = EndPoints(Curve=rotate_7.Geometry)  # -> Start, End
end_2 = EndPoints(Curve=rotate_8.Geometry)  # -> Start, End
panel_8 = Panel("""0
1
3
5""")
item_7 = ListItem(List=rotate_8.Geometry, Index="0", Wrap=True)
item_8 = ListItem(List=rotate_8.Geometry, Index=panel_7, Wrap=True)

# ---- group: FOLD / CUT
ln_13 = Line(StartPoint=end.End, EndPoint=end_2.End)
ln_14 = Line(StartPoint=end.Start, EndPoint=end_2.Start)

# ---- group: tab reflection pane
Z = UnitZ(Factor=1)
pt_5 = Point(end.Start)
move_6 = Move(Geometry=pt_5, Motion=Z)  # -> Geometry, Transform
lnpt = LinePt(Line=ln_14, Point=move_6.Geometry)

# ----
mirror_4 = Mirror(Geometry=flatten(rotate_5.Geometry), Plane=lnpt)  # -> Geometry, Transform
item_9 = ListItem(List=pt_5, Index=0, Wrap=True)
item_10 = ListItem(List=mirror_4.Geometry, Index=0, Wrap=True)
end_3 = EndPoints(Curve=ln_14)  # -> Start, End
xz_4 = XZPlane(Origin=Point(0, 0, 0))
end_4 = EndPoints(Curve=ln_13)  # -> Start, End
line_2 = Line([ln_14, ln_13, ln_3])
line_3 = Line([ln_14, ln_13])
end_5 = EndPoints(Curve=item_10)  # -> Start, End
pi = Pi(Factor=0.5)
pt_6 = Point(end_4.Start)
pt_7 = Point(end_3.Start)
panel_9 = Panel("""-1
0
1""")
rotate_9 = Rotate(Geometry=item_9, Angle=pi, Plane=end_5.End)  # -> Geometry, Transform
mirror_5 = Mirror(Geometry=ln_12, Plane=xz_4)  # -> Geometry, Transform
mirror_6 = Mirror(Geometry=crv_4, Plane=xz_4)  # -> Geometry, Transform
mirror_7 = Mirror(Geometry=crv_5, Plane=xz_4)  # -> Geometry, Transform

# ---- group: PRE ROTATED B TABS
panel_10 = Panel("""0
1
4""")
item_11 = ListItem(List=flatten(line_2), Index=panel_10, Wrap=True)

# ----
item_12 = ListItem(List=pt_7, Index=panel_9, Wrap=True)
ln_15 = Line(StartPoint=end_5.End, EndPoint=rotate_9.Geometry)

# ---- group: PRE ROTATED CUTS
crv_6 = Curve([mirror_6.Geometry, crv_4])

# ---- group: PRE ROTATED FOLDS
crv_7 = Curve([mirror_7.Geometry, crv_5, item_7, ln_4, ln_8])

# ---- group: CUT
ln_16 = Line(StartPoint=item_12, EndPoint=pt_6)

# ---- group: 3D CURVES
rad_3 = Radians(Degrees=python.theta0)
pt_8 = Point(dispatch_9.ListA)
crv_8 = Curve([ln_9, ln_10])
rotax_2 = RotateAxis(Geometry=llx_2.PointA, Angle=rad_3, Axis=ln_8)  # -> Geometry, Transform
ln_17 = Line(StartPoint=pt_8, EndPoint=rotax_2.Geometry)
ln_18 = Line(StartPoint=dispatch_3.ListA, EndPoint=rotax_2.Geometry)
crv_9 = Curve([ln_18, ln_17])
Z_2 = UnitZ(Factor=height)
xz_5 = XZPlane(Origin=Point(0, 0, 0))
mirror_8 = Mirror(Geometry=rotax_2.Geometry, Plane=xz_5)  # -> Geometry, Transform
mirror_9 = Mirror(Geometry=crv_9, Plane=xz_5)  # -> Geometry, Transform
multiplication_4 = Multiplication(A=X, B=-1)
multiplication_5 = Multiplication(A=Z_2, B=-1)
pt_9 = Point([mirror_8.Geometry, rotax_2.Geometry])
move_7 = Move(Geometry=[rotate_5.Geometry, ln_16], Motion=multiplication_4)  # -> Geometry, Transform
move_8 = Move(Geometry=move_7.Geometry, Motion=multiplication_5)  # -> Geometry, Transform
panel_11 = Panel("""0
5""")
rotate_10 = Rotate(Geometry=graft(pt_9), Angle=series, Plane=PlaneXY(0, 0, 0))  # -> flatten(Geometry), Transform
join = JoinCurves(Curves=flatten(move_8.Geometry), Preserve=False)
cp = ControlPoints(Curve=join)  # -> Points, Weights, Knots
item_13 = ListItem(List=rotate_10.Geometry, Index=panel_11, Wrap=True)
dispatch_10 = Dispatch(List=item_13, DispatchPattern=[True, False])  # -> ListA, ListB
item_14 = ListItem(List=cp.Points, Index="1", Wrap=True)
item_15 = ListItem(List=cp.Points, Index="2", Wrap=True)
ln_19 = Line(StartPoint=dispatch_10.ListA, EndPoint=dispatch_10.ListB)
ln_20 = Line(StartPoint=item_15, EndPoint=dispatch_10.ListA)
ln_21 = Line(StartPoint=item_14, EndPoint=dispatch_10.ListB)
crv_10 = Curve([ln_21, ln_20])
rotate_11 = Rotate(Geometry=graft([mirror_9.Geometry, crv_8, crv_9, ln_19, crv_10, ln_4]), Angle=series, Plane=PlaneXY(0, 0, 0))  # -> flatten(Geometry), Transform

# ----
end_6 = EndPoints(Curve=ln_7)  # -> Start, End
crv_11 = Curve([rotate_11.Geometry, rotate_4.Geometry, join])

# ---- group: ROTATED CUTS
rotate_12 = Rotate(Geometry=graft(crv_6), Angle=series, Plane=PlaneXY(0, 0, 0))  # -> Geometry, Transform

# ----
item_16 = ListItem(List=flatten(rotate_12.Geometry), Index="7", Wrap=True)
llx_3 = LineLine(Line1=item_16, Line2=ln_15)  # -> ParamA, ParamB, PointA, PointB
ln_22 = Line(StartPoint=llx_3.PointA, EndPoint=end_6.Start)
ln_23 = Line(StartPoint=llx_3.PointA, EndPoint=end_5.End)

# ---- group: ROTATED TAB CUTS
rotate_13 = Rotate(Geometry=graft(item_11), Angle=series, Plane=PlaneXY(0, 0, 0))  # -> Geometry, Transform

# ---- group: ROTATED FOLDS
rotate_14 = Rotate(Geometry=graft(crv_7), Angle=series, Plane=PlaneXY(0, 0, 0))  # -> Geometry, Transform

# ---- group: ROTATE BASE TABS WASHI
rotate_15 = Rotate(Geometry=graft(line_3), Angle=series, Plane=move.Geometry)  # -> Geometry, Transform

# ----
xz_6 = XZPlane(Origin=Point(0, 0, 0))

# ---- group: CIRCLES
crv_12 = Curve([cir, move_2.Geometry])

# ----
line_4 = Line([ln_23, item_10, ln_22])
_3d_curves = ClusterOutput(crv_11)
mirror_10 = Mirror(Geometry=line_4, Plane=xz_6)  # -> Geometry, Transform
line_5 = Line(mirror_10.Geometry)

# ---- group: ROTATED BASE CUTS
rotate_16 = Rotate(Geometry=graft([line_5, line_4]), Angle=series, Plane=xy)  # -> Geometry, Transform

# ----
panel_12 = Panel("""1
2""")
item_17 = ListItem(List=rotate_13.Geometry, Index=panel_12, Wrap=True)

# ---- group: TOP PLATE
crv_13 = Curve([rotate_4.Geometry, rotate_6.Geometry])
number_slider_3 = Slider(10, range=-5..10)
number_slider_4 = Slider(-4, range=-5..5)
join_2 = JoinCurves(Curves=flatten(crv_13), Preserve=False)
offset = OffsetCurve(Curve=join_2, Distance=number_slider_4, Corners=1)
fillet = Fillet(Curve=offset, Radius=number_slider_3)

# ---- group: bottom plate
crv_14 = Curve([ln_16, rotate_5.Geometry])
join_3 = JoinCurves(Curves=crv_14, Preserve=False)
offset_2 = OffsetCurve(Curve=join_3, Distance=number_slider_4, Corners=1)
fillet_2 = Fillet(Curve=offset_2, Radius=number_slider_3)

# ----
line_6 = Line([rotate_13.Geometry, rotate_12.Geometry, item_17])
line_7 = Line([rotate_14.Geometry, rotate_7.Geometry])
crv_15 = Curve(line_3)
line_8 = Line([rotate_12.Geometry, item_17, item_8, rotate_15.Geometry, ln_16])
line_9 = Line([item_8, rotate_12.Geometry, item_17, rotate_16.Geometry, ln_16])
crv_16 = Curve([ln_13, ln_14, rotate_14.Geometry, rotate_5.Geometry, item_7])
dupln = RemoveDuplicateLines(Lines=line_6, Tolerance=0.01)
dupln_2 = RemoveDuplicateLines(Lines=line_7, Tolerance=0.01)
dupln_3 = RemoveDuplicateLines(Lines=line_9, Tolerance=0.01)
dupln_4 = RemoveDuplicateLines(Lines=line_8, Tolerance=0.01)
kraft_slots = ClusterOutput([rotate_14.Geometry, rotate_5.Geometry])
flatwidth_2 = ClusterOutput(py3.w)
washi_folds = ClusterOutput(rotate_14.Geometry)
crv_17 = Curve([dupln, crv_12])
crv_18 = Curve(dupln_2)
crv_19 = Curve([dupln_4, crv_12])
crv_20 = Curve([dupln_3, crv_12])
kraft_folds = ClusterOutput(crv_15)
washi_cuts_2 = ClusterOutput(crv_19)

# ---- group: bottom hole
crv_21 = Curve(move_2.Geometry)

# ----
washi_folds_2 = ClusterOutput(crv_18)

# ---- group: top hole
crv_22 = Curve(cir)

# ----
washi_cuts = ClusterOutput(crv_17)
kraft_cuts = ClusterOutput(crv_20)
bottom_plate = ClusterOutput([fillet_2, crv_21])
top_plate = ClusterOutput([fillet, crv_22])

# ==== cluster SLOTMAKER
breaks = ClusterInput()
slot_width = ClusterInput()
curves_to_slot = ClusterInput()
radius = ClusterInput()
end = EndPoints(Curve=curves_to_slot)  # -> Start, End
crv = Curve(flatten(curves_to_slot))
cir = Circle(Plane=end.Start, Radius=radius)
cir_2 = Circle(Plane=end.End, Radius=radius)
dupln = RemoveDuplicateLines(Lines=crv, Tolerance=0.01)
ccx = CurveCurve(CurveA=curves_to_slot, CurveB=cir)  # -> Points, ParamsA, ParamsB
ccx_2 = CurveCurve(CurveA=curves_to_slot, CurveB=cir_2)  # -> Points, ParamsA, ParamsB
python = GhPythonScript(line=dupln, radius=radius, breaks=breaks)  # -> out, simplify(graft(line)), simplify(dashpattern); inputs breaks: Int32
# ---------- python: Python ----------
__author__ = "mrg"

import rhinoscriptsyntax as rs

dashpattern = []

dash = radius*2
dashtotal = dash*breaks

l = rs.CurveLength(line)
gap = (l-dashtotal)/(breaks + 1)

#print l, gap, dash
dashpattern.append(gap)
for b in range(breaks):
    dashpattern.append(dash)
    dashpattern.append(gap)
print dashpattern

total = 0
for d in dashpattern:
    total = total + d

print total, l

line = line
# ---------- end python ----------
ln = Line(StartPoint=ccx.Points, EndPoint=ccx_2.Points)
multiplication = Multiplication(A=slot_width, B=-1)
dash = DashPattern(Curve=python.line, Pattern=python.dashpattern)  # -> Dashes, Gaps
panel = Panel(python.dashpattern)
offcrv = OffsetCurve(
    Curve=dash.Dashes,
    Plane=PlaneXY(0, 0, 0),
    Distance=slot_width,
    BothSides=multiplication,
    Kinks=Slider(1, range=0..10),
    CapType=Slider(3, range=0..10))
larger = LargerThan(FirstNumber=slot_width, SecondNumber="0")  # -> LargerThan, OrEqualTo
filter = StreamFilter(Gate=larger.LargerThan, Stream0=dash.Dashes, Stream1=offcrv)
s_0 = ClusterOutput(filter)

# ==== cluster Cluster_2
graph_origin = ClusterInput()
origin_point = ClusterInput()
height = ClusterInput()
linkagea = ClusterInput()
linkageb = ClusterInput()
linkagec = ClusterInput()
rigid = ClusterInput()
iterations = ClusterInput()
translation = ClusterInput()
panel = Panel(translation)

# ---- group: GRAPH Y MARKERS
X = UnitX(Factor=5)
X_2 = UnitX(Factor=-5)
move = Move(Geometry=graph_origin, Motion=X)  # -> Geometry, Transform
move_2 = Move(Geometry=graph_origin, Motion=X_2)  # -> Geometry, Transform
Y = UnitY(Factor=translation)
ln = Line(StartPoint=move.Geometry, EndPoint=move_2.Geometry)
move_3 = Move(Geometry=ln, Motion=Y)  # -> Geometry, Transform
series = Series(Start=0, Step=10, Count=10)
Y_2 = UnitY(Factor=series)
move_4 = Move(Geometry=ln, Motion=Y_2)  # -> Geometry, Transform

# ----
subtraction = Subtraction(A=graph_origin, B=origin_point)

# ---- group: GRAPH DATA
python = GhPythonScript(height=height, linkageA=linkagea, linkageB=linkageb, linkageC=linkagec, rigid=rigid, iterations=iterations)  # -> out, hData, tData, rData, minH, maxH, zeroH
# ---------- python: Python ----------
__author__ = "mrg"

import rhinoscriptsyntax as rs
import math
#import numpy as np


def distributeH(start, end, iterations):
    total = end - start
    iterationstep = total/iterations
    iterationsteps = int(total/iterationstep)
    hdata = []
    for i in range(iterationsteps):
        hdata.append(start + i*iterationstep)
    hdata.append(end)
    return hdata

def getMinH(a,b,c):
    return math.sqrt(math.pow(a-b, 2) - math.pow(c,2))

def getMaxH(a,b,c):
    return math.sqrt(math.pow(a+b, 2) - math.pow(c,2))
    
def getD(h,c):
    return math.sqrt(math.pow(c,2) + math.pow(h,2))


def sin2(a):
	return math.sin(a)*math.sin(a)

def tan2(a):
	return math.tan(a)*math.tan(a)

    
def getRigidKinematicAngle (sectorAngles, pDegrees):
	# p = angle in degrees
	p = math.radians(pDegrees)
	a1 = sectorAngles[0]
	a2 = sectorAngles[1]
	a3 = sectorAngles[2]
	a4 = sectorAngles[3]
	cosa2 = math.cos(a2)
	l1 = 2*math.sin(a1)*math.sin(a2)*math.tan(p/2)
	l2 = 4*sin2(a1)*sin2(a3)*tan2(p/2) - (cosa2 - math.cos(a1 - a3 - a4) + (cosa2 - math.cos(a1 + a3 - a4))* tan2(p/2))* (cosa2 - math.cos(a1 + a3 + a4) + (cosa2 - math.cos(a1 - a3 + a4))* tan2(p/2)) 
	l3 = cosa2 - math.cos(a1 - a3 - a4) + (cosa2 - math.cos(a1 + a3 - a4))* tan2(p/2)
	halftanP = l1 * math.sqrt(l2)/l3
	halftanP_ = -l1 * math.sqrt(l2)/l3
	P = 2*math.atan(halftanP)
	P_ = 2*math.atan(halftanP_)
	#print (halftanP, halftanP_)
	return P, P_


def getIterationData(a,b,c,rigid,iterations):
    #sectorAngles = []
    rigidB = 360 - 90 - 120 - rigid
    sectorAnglesDegrees = [90, rigid, rigidB, 120]
    sectorAngleRadians = [0,0,0,0]
    for i,sa in enumerate(sectorAnglesDegrees):
        sectorAngleRadians[i] = math.radians(sa)
    # 1. calculate min and max height
    minH = getMinH(a,b,c)
    maxH = getMaxH(a,b,c)
    hData = []
    tData = []
    rData = []
    hData = distributeH(minH, maxH, iterations)
    hData.sort()
    for h in hData:
        theta0 = getTheta0(a,b,c,h)
        print(theta0, sectorAngleRadians)
        rA, rA_ = getRigidKinematicAngle(sectorAngleRadians, theta0)
        #print (h, theta0, rA, rA_)
        #hData.append(h)
        tData.append(theta0)
        rData.append(math.degrees(rA_))
    return hData, tData, rData
 

def getAngles(a,b,c,h):
    # equation 1
    d = getD(h,c)
    print "d", d
    if (d >= a+b):
        print "d is longer"
        costhetaA = 1
        thetaH = math.degrees(math.acos(c/(a+b)))
    else:
        # equation 2
        thetaH = math.degrees(math.acos(c/d))
        # equation 3
        costhetaA = ( math.pow(d,2) + math.pow(b,2) - math.pow(a,2) )/(2*d*b)
        print "d", d, "a+b", a+b, "cosø", costhetaA, "øh", thetaH
    
    if costhetaA < -1:
        costhetaA = -1
    print "costhetaA", costhetaA
    thetaA = math.degrees(math.acos(costhetaA))
    theta0 = 180 - thetaH - thetaA

    #print ("theta0", h, theta0)
    return theta0, thetaH, thetaA    
    
def getTheta0(a,b,c,h):
    # equation 1
    d = getD(h,c)
    #print("getTheta0", a, b, c, d, h)
    if d > 0:
        if (d >= a+b):
            #print "d is longer"
            costhetaA = 1
            thetaH = math.degrees(math.acos(c/(a+b)))
        else:
            # equation 2
            thetaH = math.degrees(math.acos(c/d))
            # equation 3
            costhetaA = ( math.pow(d,2) + math.pow(b,2) - math.pow(a,2) )/(2*d*b)
            #print "d", d, "a+b", a+b, "cosø", costhetaA, "øh", thetaH
        if costhetaA < -1:
            costhetaA = -1
        thetaA = math.degrees(math.acos(costhetaA))
        theta0 = 180 - thetaH - thetaA
        return theta0
    else:
         return 0  


    
minH = getMinH(linkageA,linkageB,linkageC)
maxH = getMaxH(linkageA,linkageB,linkageC)

hData, tData, rData = getIterationData(linkageA,linkageB,linkageC,rigid,iterations)

zeroHValue = min(rData, key=lambda x:abs(x-0))
zeroH = hData[rData.index(zeroHValue)]
# ---------- end python ----------
number_slider = Slider(-180, range=-180..180)
number_slider_2 = Slider(-400, range=-1000..1000)
number_slider_3 = Slider(180, range=-180..180)
number_slider_4 = Slider(100, range=0..100)
pt = ConstructPoint(XCoordinate=python.tData, YCoordinate=python.hData, ZCoordinate=0)
pt_2 = ConstructPoint(XCoordinate=python.rData, YCoordinate=python.hData, ZCoordinate=0)
rectangle = Rectangle(Plane=graph_origin, XSize=[number_slider, number_slider_3], YSize=number_slider_4, Radius=0)  # -> Rectangle, Length
intcrv = Interpolate(Vertices=pt, Degree=3, Periodic=False, KnotStyle=1)  # -> Curve, Length, Domain
intcrv_2 = Interpolate(Vertices=pt_2, Degree=3, Periodic=False, KnotStyle=1)  # -> Curve, Length, Domain
multiplication = Multiplication(A=number_slider_3, B=0.5)
move_5 = Move(Geometry=intcrv_2.Curve, Motion=subtraction)  # -> Geometry, Transform
move_6 = Move(Geometry=intcrv.Curve, Motion=subtraction)  # -> Geometry, Transform

# ----
panel_2 = Panel(python.zeroH)
zeroh = ClusterOutput(python.zeroH)

# ---- group: H LINE
X_3 = UnitX(Factor=number_slider)
X_4 = UnitX(Factor=number_slider_3)
move_7 = Move(Geometry=graph_origin, Motion=X_3)  # -> Geometry, Transform
move_8 = Move(Geometry=graph_origin, Motion=X_4)  # -> Geometry, Transform
Y_3 = UnitY(Factor=translation)
ln_2 = Line(StartPoint=move_7.Geometry, EndPoint=move_8.Geometry)
move_9 = Move(Geometry=ln_2, Motion=Y_3)  # -> Geometry, Transform

# ---- group: RANGE LABELS
roundd = RoundToDecimalPlace(NumberX=python.zeroH, DecimalPlace=2, RoundType=0)  # -> Rounded, Difference
subtraction_2 = Subtraction(A=100, B=python.zeroH)
roundd_2 = RoundToDecimalPlace(NumberX=subtraction_2, DecimalPlace=2, RoundType=0)  # -> Rounded, Difference
concat = Concatenate(FragmentA="zero : ", FragmentB=roundd.Rounded)
concat_2 = Concatenate(FragmentA="  range: ", FragmentB=roundd_2.Rounded)
concat_3 = Concatenate(FragmentA=concat, FragmentB=concat_2)

# ---- group: H LINE
X_5 = UnitX(Factor=number_slider)
X_6 = UnitX(Factor=number_slider_3)
move_10 = Move(Geometry=graph_origin, Motion=X_5)  # -> Geometry, Transform
move_11 = Move(Geometry=graph_origin, Motion=X_6)  # -> Geometry, Transform
Y_4 = UnitY(Factor=python.zeroH)
ln_3 = Line(StartPoint=move_10.Geometry, EndPoint=move_11.Geometry)
move_12 = Move(Geometry=ln_3, Motion=Y_4)  # -> Geometry, Transform

# ----
number_slider_5 = Slider(4, range=0..10)
divide = DivideCurve(Curve=move_9.Geometry, Count=7, Kinks=False)  # -> Points, Tangents, Parameters
item = ListItem(List=divide.Points, Index=1, Wrap=True)
item_2 = ListItem(List=divide.Points, Index=2, Wrap=True)
ln_4 = Line(StartPoint=item, EndPoint=item_2)
Y_5 = UnitY(Factor=number_slider_5)
move_13 = Move(Geometry=ln_4, Motion=Y_5)  # -> Geometry, Transform

addition = Addition(A=python.zeroH, B=number_slider_5)
graph_outline = ClusterOutput(rectangle.Rectangle)
theta_graph_line = ClusterOutput(move_6.Geometry)

# ---- group: R LINE
Y_6 = UnitY(Factor=number_slider_4)
move_14 = Move(Geometry=graph_origin, Motion=Vector(0, 0, 10))  # -> Geometry, Transform
move_15 = Move(Geometry=graph_origin, Motion=Y_6)  # -> Geometry, Transform
number_slider_6 = Slider(4, range=0..100)
ln_5 = Line(StartPoint=move_14.Geometry, EndPoint=move_15.Geometry)
planesrf = PlaneSurface(Plane=PlaneXY(0, 0, 0), XSize=Domain(-10, 10), YSize=Domain(-10, 10))

# ---- group: R LINE / MAX R
item_3 = ListItem(List=python.rData, Index=-1, Wrap=True)
addition_2 = Addition(A=item_3, B=10)
X_7 = UnitX(Factor=item_3)
X_8 = UnitX(Factor=addition_2)
move_16 = Move(Geometry=ln_5, Motion=X_7)  # -> Geometry, Transform
move_17 = Move(Geometry=ln_5, Motion=X_8)  # -> Geometry, Transform

# ---- group: R LINE / MIN R
item_4 = ListItem(List=python.rData, Index=0, Wrap=True)
addition_3 = Addition(A=item_4, B=-10)
X_9 = UnitX(Factor=item_4)
X_10 = UnitX(Factor=addition_3)
move_18 = Move(Geometry=ln_5, Motion=X_9)  # -> Geometry, Transform
move_19 = Move(Geometry=ln_5, Motion=X_10)  # -> Geometry, Transform

# ---- group: R LINE (continued)
textsrf = TextOnSurface(
    Text=item_4,
    Font="Sans Bold:no Italic:no",
    Height=number_slider_6,
    Depth=0.4,
    BaseLine=move_19.Geometry,
    BaseSurface=planesrf)
textsrf_2 = TextOnSurface(
    Text=item_3,
    Font="Sans Bold:no Italic:no",
    Height=number_slider_6,
    Depth=0.4,
    BaseLine=move_17.Geometry,
    BaseSurface=planesrf)
geo = Geometry([move_16.Geometry, move_18.Geometry, textsrf, textsrf_2])

# ---- group: ZERO H LINE
X_11 = UnitX(Factor=number_slider)
X_12 = UnitX(Factor=multiplication)
move_20 = Move(Geometry=graph_origin, Motion=X_11)  # -> Geometry, Transform
move_21 = Move(Geometry=graph_origin, Motion=X_12)  # -> Geometry, Transform
Y_7 = UnitY(Factor=addition)
ln_6 = Line(StartPoint=move_20.Geometry, EndPoint=move_21.Geometry)
move_22 = Move(Geometry=ln_6, Motion=Y_7)  # -> Geometry, Transform
textsrf_3 = TextOnSurface(
    Text=concat_3,
    Font="Sans Bold:no Italic:no",
    Height=number_slider_6,
    Depth=0.4,
    BaseLine=move_22.Geometry,
    BaseSurface=planesrf)

# ----
geo_2 = Geometry([rectangle.Rectangle, move_4.Geometry, textsrf_3, move_12.Geometry])
graph_frame = ClusterOutput(geo_2)
rigid_curve = ClusterOutput([geo, move_5.Geometry])
textsrf_4 = TextOnSurface(
    Text=height,
    Font="Sans Bold:no Italic:no",
    Height=number_slider_6,
    Depth=0.4,
    BaseLine=move_13.Geometry,
    BaseSurface=planesrf)
h_line = ClusterOutput([move_9.Geometry, textsrf_4])

# ==== cluster Cluster_3
panel = Panel("360-90-120")
alpha_3 = ClusterInput()
subtraction = Subtraction(A="150", B=alpha_3)
rad = Radians(Degrees="120")
rad_2 = Radians(Degrees=subtraction)
rad_3 = Radians(Degrees="90")
rad_4 = Radians(Degrees=alpha_3)

# ---- group: a1-a4
subtraction_2 = Subtraction(A=rad, B=rad_2)
abs = Absolute(Value=subtraction_2)
panel_2 = Panel(abs)

# ---- group: a2-A3
subtraction_3 = Subtraction(A=rad_3, B=rad_4)
abs_2 = Absolute(Value=subtraction_3)
panel_3 = Panel(abs_2)

# ----
larger = LargerThan(FirstNumber=panel_2, SecondNumber=panel_3)  # -> LargerThan, OrEqualTo
panel_4 = Panel(larger.OrEqualTo)
or_equal_to = ClusterOutput(larger.OrEqualTo)
